# Requirement set HLR (R2024b)

## 1 [HLR-IP-001]
The software shall monitor pedestrian button inputs from four button sensors and detect press events within 100ms.

## 2 [HLR-SC-001]
The software shall execute pedestrian crossing sequences including vehicle amber, vehicle red, pedestrian green, pedestrian red, vehicle green phases.

## 3 [HLR-TLC-001]
The software shall control 14 individual light outputs (6 vehicle, 6 public transport, 4 pedestrian) and maintain current state information.

## 4 [HLR-TLC-003]
The software shall implement safety interlocks preventing conflicting green signals on the same carriageway.